# Dynamo custom node Authentication.ByLoginIdAndPassword.dyf (Dynamo 1.3.3.4651)
# category: DynaMattermost.Actions
# Authenticates a user with the Mattermost service. Returns a token that is needed in subsequent interactions with the Mattermost API.

baseURL = Input(baseURL : string)
byUrl = DynaWeb.WebClient.ByUrl(baseURL)
loginID = Input(loginID : string)
password = Input(password : string)
code_block = CodeBlock(user=loginID, pw=password)
# ---------- code_block.designscript (7 lines) ----------
"api/v4/users/login";
"POST";
"undefined";
"{\"login_id\":\"" + user + "\",\"password\":\"" + pw + "\"}";
"RequestBody";
"Content-Type";
"application/json";
# ----------------------------------------
byEndpoint = DynaWeb.WebRequest.ByEndpoint(code_block.out0)
setMethod = DynaWeb.WebRequest.SetMethod(byEndpoint, code_block.out1)
addParameter = DynaWeb.WebRequest.AddParameter(setMethod, code_block.out2, code_block.out3, code_block.out4)
addHeader = DynaWeb.WebRequest.AddHeader(addParameter, code_block.out5, code_block.out6)
execute = DynaWeb.WebClient.Execute(byUrl, addHeader)
headers = DynaWeb.WebResponse.Headers(execute)
code_block_2 = CodeBlock(seq=headers)
# ---------- code_block_2.designscript (4 lines) ----------
// Properties
seq[0];
// Values
seq[1];
# ----------------------------------------
headerProperties = Output(code_block_2.out0)
headerValues = Output(code_block_2.out1)
content = DynaWeb.WebResponse.Content(execute)
deserialiseAsDictionary = DynaWeb.Helpers.DeserialiseAsDictionary(content)
userProperties = Output(deserialiseAsDictionary.out0)
userValues = Output(deserialiseAsDictionary.out1)
