# Dynamo custom node DirectMessage.ByChannelID.dyf (Dynamo 1.3.3.4651)
# category: DynaMattermost.Create
# Sends a direct message to a given channel

baseUrl = Input(baseUrl : string)
byUrl = DynaWeb.WebClient.ByUrl(baseUrl)
channelID = Input(channelID : string)
message = Input(message : string)
token = Input(token : string)
code_block = CodeBlock(channelID=channelID, message=message, token=token)
# ---------- code_block.designscript (9 lines) ----------
"api/v4/posts";
"POST";
"undefined";
"{\"channel_id\":\"" + channelID + "\",\"message\":\"" + message + "\"}";
"RequestBody";
"Content-Type";
"application/json";
"Authorization";
"Bearer " + token;
# ----------------------------------------
byEndpoint = DynaWeb.WebRequest.ByEndpoint(code_block.out0)
setMethod = DynaWeb.WebRequest.SetMethod(byEndpoint, code_block.out1)
addParameter = DynaWeb.WebRequest.AddParameter(setMethod, code_block.out2, code_block.out3, code_block.out4)
addHeader = DynaWeb.WebRequest.AddHeader(addParameter, code_block.out5, code_block.out6)
addHeader_2 = DynaWeb.WebRequest.AddHeader(addHeader, code_block.out7, code_block.out8)
execute = DynaWeb.WebClient.Execute(byUrl, addHeader_2)
headers = DynaWeb.WebResponse.Headers(execute)
code_block_2 = CodeBlock(seq=headers) { seq[0]; seq[1]; }
headerProperties = Output(code_block_2.out0)
headerValues = Output(code_block_2.out1)
content = DynaWeb.WebResponse.Content(execute)
deserialiseAsDictionary = DynaWeb.Helpers.DeserialiseAsDictionary(content)
messageProperties = Output(deserialiseAsDictionary.out0)
messageValues = Output(deserialiseAsDictionary.out1)
