# Dynamo custom node DirectMessageChannel.ByUsers.dyf (Dynamo 1.3.3.4651)
# category: DynaMattermost.Create
# Creates a direct message channel between several users (or retrieves that channel if it already exists).

baseURL = Input(baseURL : string)
byUrl = DynaWeb.WebClient.ByUrl(baseURL)
userIDs = Input(userIDs : string[])
code_block = CodeBlock(userid=userIDs) { "api/v4/channels/direct"; "POST"; ", "; "\"" + userid + "\""; }
byEndpoint = DynaWeb.WebRequest.ByEndpoint(code_block.out0)
setMethod = DynaWeb.WebRequest.SetMethod(byEndpoint, code_block.out1)
join = String.Join(code_block.out2, code_block.out3)
token = Input(token : string)
code_block_2 = CodeBlock(seq=join, token=token) { "undefined"; "[" + seq[0] + "]"; "RequestBody"; "Content-Type"; "application/json"; "Authorization"; "Bearer " + token; }
addParameter = DynaWeb.WebRequest.AddParameter(setMethod, code_block_2.out0, code_block_2.out1, code_block_2.out2)
addHeader = DynaWeb.WebRequest.AddHeader(addParameter, code_block_2.out3, code_block_2.out4)
addHeader_2 = DynaWeb.WebRequest.AddHeader(addHeader, code_block_2.out5, code_block_2.out6)
execute = DynaWeb.WebClient.Execute(byUrl, addHeader_2)
headers = DynaWeb.WebResponse.Headers(execute)
code_block_3 = CodeBlock(seq=headers) { seq[0]; seq[1]; }
headerProperties = Output(code_block_3.out0)
headerValues = Output(code_block_3.out1)
content = DynaWeb.WebResponse.Content(execute)
deserialiseAsDictionary = DynaWeb.Helpers.DeserialiseAsDictionary(content)
channelProperties = Output(deserialiseAsDictionary.out0)
channelValues = Output(deserialiseAsDictionary.out1)
