# Dynamo custom node Helpers.SplitJSONArray.dyf (Dynamo 1.3.3.4651)
# category: DynaMattermost.Actions
# Converts a JSON Array into a list of single JSON objects.

json = Input(json : string)
length = String.Length(json)
code_block = CodeBlock(n=length) { 1; n-2; "},{"; -1; }
substring = String.Substring(str=json, startIndex=code_block.out0, length=code_block.out1)
split = String.Split(substring, code_block.out2)
deconstruct = List.Deconstruct(list=split)
dropItems = List.DropItems(list=deconstruct.rest, amount=code_block.out3)
lastItem = List.LastItem(deconstruct.rest)
code_block_2 = CodeBlock(first=deconstruct.first, middle=dropItems, last=lastItem) { first + "}"; "{" + middle + "}"; "{" + last; }
join = List.Join(code_block_2.out0, code_block_2.out1, code_block_2.out2)
firstItem = List.FirstItem(split)
count = List.Count(split)
code_block_3 = CodeBlock(trueval=join, falseval=firstItem, n=count) { result = {trueval, falseval}; result[n > 1 ? 0 : 1]; }
seq = Output(code_block_3.out1)
