# Dynamo custom node User.Teams.dyf (Dynamo 1.3.3.4651)
# category: DynaMattermost.Query
# Retrieves all teams of a given user

baseURL = Input(baseURL : string)
byUrl = DynaWeb.WebClient.ByUrl(baseURL)
userID = Input(userID : string)
token = Input(token : string)
code_block = CodeBlock(user_id=userID, token=token) { "api/v4/users/" + user_id + "/teams"; "GET"; "Content-Type"; "application/json"; "Authorization"; "Bearer " + token; }
byEndpoint = DynaWeb.WebRequest.ByEndpoint(code_block.out0)
setMethod = DynaWeb.WebRequest.SetMethod(byEndpoint, code_block.out1)
addHeader = DynaWeb.WebRequest.AddHeader(setMethod, code_block.out2, code_block.out3)
addHeader_2 = DynaWeb.WebRequest.AddHeader(addHeader, code_block.out4, code_block.out5)
execute = DynaWeb.WebClient.Execute(byUrl, addHeader_2)
headers = DynaWeb.WebResponse.Headers(execute)
code_block_2 = CodeBlock(seq=headers)
# ---------- code_block_2.designscript (4 lines) ----------
// Properties
seq[0];
// Values
seq[1];
# ----------------------------------------
headerProperties = Output(code_block_2.out0)
headerValues = Output(code_block_2.out1)
content = DynaWeb.WebResponse.Content(execute)
splitJSONArray = Custom[Helpers.SplitJSONArray](json=content)  # Converts a JSON Array into a list of single JSON objects.
deserialiseAsDictionary = DynaWeb.Helpers.DeserialiseAsDictionary(splitJSONArray)
teamProperties = Output(deserialiseAsDictionary.out0)
teamValues = Output(deserialiseAsDictionary.out1)
