# Dynamo custom node Value.ByKey.dyf (Dynamo 1.3.3.4651)
# category: DynaMattermost.Actions
# Looks up a key in one list and returns the corresponding value from another list

values = Input(values : var[])
keys = Input(keys : var[])
search = Input(search : var)
firstIndexOf = List.FirstIndexOf(list=keys, item=search)
getItemAtIndex = List.GetItemAtIndex(list=values, index=firstIndexOf)
value = Output(getItemAtIndex)
