# Dynamo graph SendDirectMessage.dyn (Dynamo 1.3.3.4651)

# group: INPUTS
base_url = StringInput("")
sender_id = StringInput("")
sender_password = StringInput("")
recipient_user_name = StringInput("")
message = StringInput("")

# group: Obtain session token
byLoginIdAndPassword = Custom[Authentication.ByLoginIdAndPassword](baseURL=base_url, loginID=sender_id, password=sender_password)
code_block = CodeBlock(headerKey=byLoginIdAndPassword.headerProperties, userKey=byLoginIdAndPassword.userProperties) { headerKey == "Token"; userKey == "id"; }
filterByBoolMask = List.FilterByBoolMask(list=byLoginIdAndPassword.headerValues, mask=code_block.out0)
# note: Token
firstItem = List.FirstItem(filterByBoolMask.in)
filterByBoolMask_2 = List.FilterByBoolMask(list=byLoginIdAndPassword.userValues, mask=code_block.out1)
# note: User ID
firstItem_2 = List.FirstItem(filterByBoolMask_2.in)

# group: Obtain current user's ID
byUsername = Custom[Users.ByUsername](baseURL=base_url, token=firstItem, searchTerms=recipient_user_name)
code_block_2 = CodeBlock(key=byUsername.userProperties) { key == "id"; }
filterByBoolMask_3 = List.FilterByBoolMask(list=byUsername.userValues, mask=code_block_2)
flatten = Flatten(filterByBoolMask_3.in)
firstItem_3 = List.FirstItem(flatten)

# group: Create direct message channel and send message
create = List.Create(firstItem_2, firstItem_3)
byUsers = Custom[DirectMessageChannel.ByUsers](baseURL=base_url, token=firstItem, userIDs=create)
code_block_3 = CodeBlock(key=byUsers.channelProperties) { key == "id"; }
filterByBoolMask_4 = List.FilterByBoolMask(list=byUsers.channelValues, mask=code_block_3)
# note: Channel ID
firstItem_4 = List.FirstItem(filterByBoolMask_4.in)
byChannelID = Custom[DirectMessage.ByChannelID](baseUrl=base_url, token=firstItem_4, channelID=message, message=firstItem)  # Sends a direct message to a given channel
